# Grasshopper definition chitin_panels.gh (Grasshopper 1.0.7)

# Parametric Chitin Panels, v1, 09.06.2023
# 
# Inputs:
# a) radius
# b) frame thickness
# c) number of pins
# d) polygon segments
# 
# Step 1
# 
# Generating the outer frame.
# 
# Step 2
# 
# Adding the attachment system, whether it is pins or extrusions.
# 
# Step 3
# 
# Adding the necessary reişnforcements for 3DP. For example, adding filleted edges for exturded pins.
# 
# Step 4
# 
# Creating the path curves.
number_slider = Slider(110, range=0..200)

number_slider_2 = Slider(6, range=0..10)
number_slider_3 = Slider(12, range=0..100)

panel = Panel("height of pins")

polygon = Polygon(Plane=PlaneXY(0, 0, 0), Radius=number_slider, Segments=Slider(6, range=0..10), FilletRadius=0)  # -> Polygon, Length
neg = Negative(Value=number_slider_2)
merge = Merge(Data1=number_slider_2, Data2=neg)
Z = UnitZ(Factor=number_slider_2)
# Step 1
offset = OffsetCurve(Curve=polygon.Polygon, Distance=merge, Corners=1)
extr = Extrude(Base=flatten(offset), Direction=Z)
cap = CapHoles(Brep=extr)
bang = ExplodeTree(Data=graft(cap))  # -> Branch0, Branch1
sdiff = SolidDifference(BrepsA=bang.Branch0, BrepsB=bang.Branch1)

divide = DivideCurve(Curve=polygon.Polygon, Count=number_slider_3, Kinks=False)  # -> Points, Tangents, Parameters
pt = Point(divide.Points)

Z_2 = UnitZ(Factor=Slider(4, range=0..10))
brep = Brep(sdiff)
move = Move(Geometry=divide.Points, Motion=Z_2)  # -> Geometry, Transform
# Step 2
ln = Line(StartPoint=divide.Points, EndPoint=move.Geometry)
Z_3 = UnitZ(Factor=Slider(1, range=0..10))
pipe = Pipe(Curve=ln, Radius=1, Caps=2)
move_2 = Move(Geometry=pipe, Motion=Z_3)  # -> Geometry, Transform
entwine = Entwine(Branch00=move_2.Geometry, Branch01=brep, FlattenInputs=True)  # -> flatten(Result)

# ----
# Step 2_v2
brep_2 = Brep(<brep referenced from the Rhino model>)
area = Area(Geometry=polygon.Polygon)  # -> Area, Centroid
arrpolar = PolarArray(Geometry=brep_2, Plane=area.Centroid, Count=number_slider_3, Angle=6.283185307)  # -> Geometry, Transform

area_2 = Area(Geometry=polygon.Polygon)  # -> Area, Centroid

sunion = SolidUnion(Breps=flatten(entwine))  # disabled
debrep = DeconstructBrep(Brep=sunion)  # -> Faces, Edges, Vertices
cls = Closed(Curve=debrep.Edges)  # -> Closed, Periodic
cull = CullPattern(List=debrep.Edges, CullPattern=cls.Closed)
dispatch = Dispatch(List=cull, DispatchPattern=[True, False])  # -> ListA, ListB
# Step 3
number_slider_4 = Slider(0.6, range=0..1)
index = ItemIndex(List=debrep.Edges, Item=dispatch.ListB)
split = SplitList(List=index, Index=1)  # -> ListA, ListB
lng = ListLength(List=split.ListB)
repeat = RepeatData(Data=number_slider_4, Length=lng)
filedge = FilletEdge(Shape=sunion, Blend=0, Metric=0, Edges=split.ListB, Radii=repeat)  # disabled

moveaway = MoveAwayFrom(Geometry=divide.Points, Emitter=area_2.Centroid, Distance=10)  # -> Geometry, Transform
ln_2 = Line(StartPoint=moveaway.Geometry, EndPoint=reverse(moveaway.Geometry))
ln_3 = Line(StartPoint=moveaway.Geometry, EndPoint=graft(moveaway.Geometry))
midpt = CurveMiddle(Curve=ln_3)
# Step 4
join = JoinCurves(Curves=flatten(ln_3), Preserve=False)
cullpt = CullDuplicates(Points=midpt, Tolerance=0.1, CullMode=3)  # -> Points, Indices, Valence
item = ListItem(List=join, Index=Slider(2, range=0..10), Wrap=True)
graft = GraftTree(Tree=ln_3, IncludeEmptyLists=True, IncludeNullItems=True)

# ----
# Step 4 (simple)
ln_4 = Line(StartPoint=divide.Points, EndPoint=graft(divide.Points))
pipe_2 = Pipe(Curve=ln_4, Radius=Slider(0.4, range=0..1), Caps=0)
dispatch_2 = Dispatch(List=flatten(ln_4), DispatchPattern=[True, False])  # -> ListA, ListB
crv = Curve(dispatch_2.ListA)

# ----
# dividing a hand-drawn curve
crv_2 = Curve(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)
explode = Explode(Curve=crv_2, Recursive=True)  # -> Segments, Vertices
end = EndPoints(Curve=explode.Segments)  # -> Start, End
item_2 = ListItem(List=end.End, Index=Slider(11, range=0..100), Wrap=True)
panel_2 = Panel(end.End)
